# Dynamo graph bridge_wizard.dyn (Dynamo 2.19.4.6671)
# Parametric bridge wizard for Civil 3D. Inputs: Repo Root Folder = the c3d-bridge-modeler repository folder; Bridge Params (JSON) = your project's parameter file (copy test/params.phase1.example.json and edit alignment/profile/surface names, stations, girders). Open the drawing with the bridge alignment data shortcuts attached, then Run. Creates the editable skeleton (support/bearing sample lines, deck plan polygon) and regenerates the solids (girders, haunches, deck slab) on BRIDGE-* layers. The Build Report output shows per-girder bearing elevations and a summary of created/preserved entities.

repo_root_folder = Directory("C:\Users\ejimenez\OneDrive - Stantec\Documents\Py\c3d-bridge-modeler")  # graph input
bridge_params_json = Filename("..\test\params.phase1.local.json")  # graph input
bridge_wizard_engine = Python(IN[0]=repo_root_folder, IN[1]=bridge_params_json)  # CPython3
# ---------- bridge_wizard_engine.python (56 lines) ----------
import sys
import os

# Reload trigger — bump this number after `git pull` to force Dynamo to
# treat the node as dirty and re-execute (Dynamo caches by node-body
# content, so a no-op text change is enough). This is the only edit you
# typically need to make to the node body itself; everything else lives
# in the imported `src/*.py` files and is reloaded via the sys.modules
# purge below.
print("[phase1_node] reload trigger v28")

repo_root = IN[0]                                               # noqa: F821
params_path = IN[1]                                             # noqa: F821

src_path = os.path.join(repo_root, "src")

# Defensive: sys.path persists across Dynamo graph runs. If the user
# previously pointed `repo_root` at a different clone (e.g. an old
# OneDrive-backed working copy), THAT path is still in sys.path and
# can shadow our new clone for some imports. Strip any stale
# c3d-bridge-modeler entries before inserting the current one.
sys.path[:] = [p for p in sys.path if "c3d-bridge-modeler" not in p]
sys.path.insert(0, src_path)

# Drop every Phase 1 src/ module from sys.modules so the next import is
# fresh — `importlib.reload` only refreshes a single module, leaving its
# already-imported dependencies stale.
_OWN_MODULES = (
    "phase1_build",
    "phase1_compute",
    "phase1_params",
    "station_profile",
    "elevation",
    "units",
    "aisc",
    "skeleton",
    "bridge_lines",
    "deck_polygon",
    "deck_plan",
    "girders",
    "girder_geometry",
    "haunches",
    "haunch_geometry",
    "decks",
    "deck_geometry",
    "layers",
    "xdata",
    "c3d_doc",
    "alignment",
)
for _name in _OWN_MODULES:
    if _name in sys.modules:
        del sys.modules[_name]

import phase1_build
OUT = phase1_build.main(repo_root, params_path)                 # noqa: F821
# ----------------------------------------
build_report = Watch(bridge_wizard_engine)  # graph output
