# Dynamo graph phase0_bridge.dyn (Dynamo 2.19.4.6671)

directory_path = Directory("C:\Users\ejimenez\OneDrive - Stantec\Documents\Py\c3d-bridge-modeler")
file_path = Filename("..\test\params.local.json")
python_script = Python(IN[0]=directory_path, IN[1]=file_path)  # CPython3
# ---------- python_script.python (33 lines) ----------
import sys
import os

# Reload trigger — bump this number after `git pull` to force Dynamo to
# treat the node as dirty and re-execute (Dynamo caches by node-body
# content, so a no-op text change is enough). This is the only edit you
# typically need to make to the node body itself; everything else lives
# in the imported `src/*.py` files and is reloaded via the sys.modules
# purge below.
print("[node] reload trigger v12")

repo_root = IN[0]                                               # noqa: F821
params_path = IN[1]                                             # noqa: F821

src_path = os.path.join(repo_root, "src")
if src_path not in sys.path:
    sys.path.insert(0, src_path)

# During dev we want every node run to pick up edits across the whole
# src/ tree. `importlib.reload(build)` only refreshes `build` itself —
# its already-imported dependencies (`purge`, `solids`, etc.) keep their
# stale module objects, and `build.purge` still references the old one.
# Drop every src/ module from sys.modules so the next import is fresh.
_OWN_MODULES = (
    "build", "params", "c3d_doc", "alignment",
    "layers", "solids", "xdata", "purge",
)
for _name in _OWN_MODULES:
    if _name in sys.modules:
        del sys.modules[_name]

import build
OUT = build.main(repo_root, params_path)                        # noqa: F821
# ----------------------------------------
watch = Watch(python_script)
